# Grasshopper definition TreePlot.gh (Grasshopper 1.0.7)
# plug-ins: Human

pipeline = GeometryPipeline(
    GroupByLayer=False,
    GroupByType=False,
    IncludeHidden=True,
    IncludeLocked=True,
    LayerFilter="ON_AREA",
    NameFilter="*",
    SublayerFiltering=True,
    TypeFilter=4)
pipeline_2 = GeometryPipeline(
    GroupByLayer=False,
    GroupByType=False,
    IncludeHidden=True,
    IncludeLocked=True,
    LayerFilter="OFF_AREA",
    NameFilter="*",
    SublayerFiltering=True,
    TypeFilter=4)
panel = Panel(pipeline)
bbox = BoundingBox(Content=pipeline, Plane=PlaneXY(0, 0, 0), UnionBox=True)  # -> Box, Box_2
number_slider = Slider(2000, range=0..1000000)
number_slider_2 = Slider(10, range=0..10)
debrep = DeconstructBrep(Brep=bbox.Box)  # -> Faces, Edges, Vertices
len = Length(Curve=debrep.Edges)
addition = Addition(A=number_slider_2, B="1")
random = Random(Range=Domain(0, 1), Number=number_slider, Seed=2)
item = ListItem(List=len, Index=0, Wrap=True)  # -> Item, Item1
random_2 = Random(Range=Domain(0, 1), Number=number_slider, Seed=number_slider_2)
item_2 = ListItem(List=debrep.Vertices, Index=0, Wrap=True)
横サイズ = Panel(item.Item)
縦サイズ = Panel(item.Item1)
multiplication = Multiplication(A=item.Item, B=random_2)
multiplication_2 = Multiplication(A=item.Item1, B=random)
num = Number()
pt = PointOriented(BasePlane=item_2, UComponent=multiplication, VComponent=multiplication_2, WComponent=0)
rdiff = RegionDifference(CurvesA=pipeline, CurvesB=pipeline_2)
pt_2 = Point(pt)
Z = UnitZ(Factor=Slider(1, range=0..100))
cullpt = CullDuplicates(Points=pt_2, Tolerance=Slider(1000, range=0..5000), CullMode=3)  # -> Points, Indices, Valence
move = Move(Geometry=rdiff, Motion=Z)  # -> Geometry, Transform
move_2 = Move(Geometry=pipeline_2, Motion=Z)  # -> Geometry, Transform
boundary = BoundarySurfaces(Edges=move.Geometry)
boundary_2 = BoundarySurfaces(Edges=move_2.Geometry)
incurves = PointInCurves(Point=cullpt.Points, Curves=pipeline)  # -> Relationship, Index, Point
incurves_2 = PointInCurves(Point=cullpt.Points, Curves=pipeline_2)  # -> Relationship, Index, Point
not = GateNot(A=incurves_2.Relationship)
preview = CustomPreview(Geometry=boundary, Material=ColourSwatch(SwatchColor=RGB(255, 190, 120)))
preview_2 = CustomPreview(Geometry=boundary_2, Material=ColourSwatch(SwatchColor=RGB(153, 255, 243)))
and = GateAnd(A=incurves.Relationship, B=not)
cull = CullPattern(List=cullpt.Points, CullPattern=and)
pt_3 = Point(cull)
brep = Brep(<brep referenced from the Rhino model>)
brep_2 = Brep(brep)
pt_4 = Point(pt_3)
smesh = SimpleMesh(Brep=brep_2)

number_slider_3 = Slider(0.5, range=0..1)
pt_5 = Point(pt_3)
lng = ListLength(List=pt_5)
subtraction = Subtraction(A=number_slider_3, B="1")
subtraction_2 = Subtraction(A=lng, B="1")
xy = XYPlane(Origin=pt_5)
dom = ConstructDomain(DomainStart=subtraction, DomainEnd=number_slider_3)
range = Range(Domain=dom, Steps=subtraction_2)
panel_2 = Panel(dom)
multiplication_3 = Multiplication(A=range, B=Slider(180, range=0..180))
prot = RotatePlane(Plane=xy, Angle=degrees(multiplication_3))

mesh = Mesh([<mesh referenced from the Rhino model> x2])
mesh_2 = Mesh(mesh)
graph = GraphMapper(
    x0=0,
    x1=1,
    y0=0,
    y1=1,
    container_name="Bezier",
    cpx=[0, 0.6010713577, 0.7445360422, 1],
    cpy=[0.3243709207, 0.6495935917, 1, 1])
lng_2 = ListLength(List=pt_4)
objatts = ObjectAttributes(ObjectOrAttributes=mesh_2)  # -> Name, LayerName, LayerFullPath, Color, MaterialName, LinetypeName, GroupIndices, PlotWeight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
subtraction_3 = Subtraction(A=lng_2, B="1")
xy_2 = XYPlane(Origin=pt_4)
dom_2 = ConstructDomain(DomainStart=Slider(0.694, range=0..1), DomainEnd=Slider(1.3, range=0..3))
merge = Merge(Data1="Block", Data2="::", Data3="block001")
range_2 = Range(Domain=dom_2, Steps=subtraction_3)
panel_3 = Panel(subtraction_3)
join = TextJoin(Text=merge)
panel_4 = Panel(join)
createatts = CreateAttributes(LayerName=join, MaterialName=objatts.MaterialName, enableFullPath=True)
jitter = Jitter(List=range_2, Jitter=Slider(1, range=0..1), Seed=2)  # -> Values, Indices
defblock = DefineBlock(BlockName="block001", Geometry=mesh_2, Attributes=createatts, BlockOrigin=PlaneXY(0, 0, 0), Overwrite=True)
createatts_2 = CreateAttributes(LayerName=join, enableFullPath=True)
panel_5 = Panel(range_2)
xy_3 = XYPlane(Origin=Point(0, 0, 0))
num_2 = Number(jitter.Values)
orient = Orient(Geometry=brep, Source=xy_3, Target=prot)  # -> Geometry, Transform
scale_nu = ScaleNU(Plane=prot, ScaleX=num_2, ScaleY=num_2, ScaleZ=num_2)  # -> Geometry, Transform
orient_2 = Orient(Source=xy_3, Target=prot)  # -> Geometry, Transform
transform = Transform(flatten(scale_nu.Transform))
transform_2 = Transform(flatten(orient_2.Transform))
number_slider_4 = Slider(180, range=0..1000)
scale_nu_2 = ScaleNU(Geometry=orient.Geometry, Plane=prot, ScaleX=num_2, ScaleY=num_2, ScaleZ=num_2)  # -> Geometry, Transform
merge_2 = Merge(Data1=graft(transform_2), Data2=graft(transform))
edges = BrepEdges(Brep=scale_nu_2.Geometry)  # -> Naked, Interior, NonManifold
box = CenterBox(Base=PlaneXY(0, 0, 0), X=Slider(4644, range=0..10000), Y=Slider(206, range=0..10000), Z=1)
srf = Surface(<surface referenced from the Rhino model>)
panel_6 = Panel(num_2)
preview_3 = CustomPreview(Geometry=edges.Interior, Material=ColourSwatch(SwatchColor=RGB(41, 169, 255)))
comp = Compound(Transforms=merge_2)
transform_3 = Transform()
panel_7 = Panel(comp)
placeblock = PlaceBlock(BlockName=defblock, Transform=comp, Bake=Button(), Attributes=createatts_2)
